# Grasshopper definition Furniture - Automation.gh (Grasshopper 1.0.8)
# plug-ins: opennest_2 Info, LunchBox

panel = Panel("C:\Users\ÜNAL\OneDrive\Desktop\projects\dodo piza - ısparta - furniture automation\Furniture - Automation.xlsx")
excelread = ExcelReader(ReadExcelData=Toggle(True), WorkbookPath=panel, WorksheetName="Sayfa1", DataStruct=False)  # -> Exceptions, ColumnHeaderNames, ExcelData
number_slider = Slider(2800, range=2100..5600)
xy = XYPlane(Origin=Point(0, 0, 0))
split = SplitTree(Data=excelread.ExcelData, Masks="{0}")  # -> Positive, Negative
rectangle = Rectangle(Plane=xy, XSize=number_slider, YSize=Slider(2100, range=2100..5600), Radius=0)  # -> Rectangle, Length
c_script = CSharpScript(excelData=split.Negative)  # -> W, L, R, W2, L2, R2; inputs excelData: tree of String
# ---------- c_script: C# ----------
// Grasshopper Script Instance
#region Usings
using System;
using System.Linq;
using System.Collections;
using System.Collections.Generic;
using System.Drawing;

using Rhino;
using Rhino.Geometry;

using Grasshopper;
using Grasshopper.Kernel;
using Grasshopper.Kernel.Data;
using Grasshopper.Kernel.Types;
#endregion

public class Script_Instance : GH_ScriptInstance
{
    #region Notes
    /* 
      Members:
        RhinoDoc RhinoDocument
        GH_Document GrasshopperDocument
        IGH_Component Component
        int Iteration

      Methods (Virtual & overridable):
        Print(string text)
        Print(string format, params object[] args)
        Reflect(object obj)
        Reflect(object obj, string method_name)
    */
    #endregion

    private void RunScript(
		DataTree<string> excelData,
		ref object W,
		ref object L,
		ref object R,
		ref object W2,
		ref object L2,
		ref object R2)
    {
        List<double> Widths_Sofa   = new List<double>();
        List<double> Lengths_Sofa  = new List<double>();
        List<double> Radiuses_Sofa = new List<double>();

        List<double> Widths_Table   = new List<double>();
        List<double> Lengths_Table  = new List<double>();
        List<double> Radiuses_Table = new List<double>();


        if (excelData == null || excelData.BranchCount == 0) return;

        int rowCount = excelData.Branch(0).Count;

        for (int i = 0; i < rowCount; i++)
        {

            bool w_ok = double.TryParse(excelData.Branch(0)[i], out double w);
            bool l_ok = double.TryParse(excelData.Branch(1)[i], out double l);
            bool m_ok = int.TryParse(excelData.Branch(2)[i], out int m);
            bool r_ok = double.TryParse(excelData.Branch(3)[i], out double r);
            bool c_ok = int.TryParse(excelData.Branch(4)[i], out int c);


            if (!w_ok || !l_ok || !m_ok || !r_ok || !c_ok) continue;

            for (int j = 0; j < c; j++)
            {
                if (m == 1)
                {
                    Widths_Sofa.Add(w);
                    Lengths_Sofa.Add(l);
                    Radiuses_Sofa.Add(r);
                }
                else if (m == 2)
                {
                    Widths_Table.Add(w);
                    Lengths_Table.Add(l);
                    Radiuses_Table.Add(r);
                }
            }
        }

        W  = Widths_Sofa;
        L  = Lengths_Sofa;
        R  = Radiuses_Sofa;
        W2 = Widths_Table;
        L2 = Lengths_Table;
        R2 = Radiuses_Table;
    }
}
# ---------- end c_script ----------
crv = Curve(rectangle.Rectangle)
xy_2 = XYPlane(Origin=Point(0, 0, 0))
area = Area(Geometry=crv)  # -> Area, Centroid
rectangle_2 = Rectangle(Plane=xy_2, XSize=c_script.L, YSize=c_script.W, Radius=c_script.R)  # -> Rectangle, Length
area_2 = Area(Geometry=rectangle_2.Rectangle)  # -> Area, Centroid
crv_2 = Curve(rectangle_2.Rectangle)
project = Project(Geometry=crv_2, Plane=PlaneXY(0, 0, 0))  # -> Geometry, Transform
ma = MassAddition(Input=area_2.Area)  # -> Result, PartialResults
expression = Expression(x=ma.Result, y=area.Area, Expression="Ceiling((x * 1.5) / y)")
pack = PackObjects(Geo=crv_2, Plane=project.Geometry, X=1, Y=1, Tolerance=0)  # -> Geo, Transformation
geometry = Geometry(Outlines=pack.Geo, Simplify=-100, Hull=False, Offset="10")  # -> Geometry, Borders
series = Series(Start=0, Step=number_slider, Count=expression)
X = UnitX(Factor=series)
move = Move(Geometry=crv, Motion=X)  # -> Geometry, Transform
offset = OffsetCurve(Curve=move.Geometry, Distance="-10", Corners=1)
sheets = Sheets(Polylines=offset, Gap=0.1, Copies=expression, Offset=0)  # -> Sheets, Polylines
opennest2 = OpenNest2(
    Sheets=sheets.Sheets,
    Geometry=geometry.Geometry,
    Iterations="10",
    Run=Toggle(True),
    opt_all_rotations=1,
    opt_batch=1,
    opt_element_holes=1,
    opt_font="MecSoft_Font-1 1",
    opt_mutation=10,
    opt_num_of_rotations=2,
    opt_placement_type=1,
    opt_population=10,
    opt_seed=30,
    options_expanded=True)  # -> Sheets, Borders, AllGeometry, Transforms, SheetId, SheetTxt, Attributes
xy_3 = XYPlane(Origin=Point(0, 0, 0))
area_3 = Area(Geometry=opennest2.AllGeometry)  # -> Area, Centroid
preview = CustomPreview(
    Geometry=opennest2.AllGeometry,
    Material={diffuse=RGB(221, 160, 221), emission=RGB(66, 48, 66), shine=0.5, specular=RGB(255, 255, 255), transparency=0})
crv_3 = Curve(<curve referenced from the Rhino model>)
pcx = CurvePlane(Curve=crv_3, Plane=xy_3)  # -> Points, ParamsC, ParamsP
orient = Orient(Geometry=crv_3, Source=pcx.Points, Target=area_3.Centroid)  # -> Geometry, Transform
